# Grasshopper definition sample.gh (Grasshopper 1.0.7)
# plug-ins: tcp_connnection

division = Division(A="30", B="3")
series = Series(Start=0, Step=1, Count="30")
partition = PartitionList(List=series, Size=division)  # -> simplify(Chunks)
python = GhPythonScript(update=Button(), step="5")  # -> out, view, bound, colors, points; inputs update: Boolean, step: Int32
# ---------- python: Python ----------
__author__ = "Seghier Mohamed Abdelaziz"
__version__ = "2022.02.11"

import System
import Rhino as rh
import Rhino.Geometry as rg

"""
System.Drawing.Bitmap.GetBounds(view,unit)[0]
System.Drawing.RectangleF.Width
System.Drawing.RectangleF.Height
System.Drawing.Bitmap.GetPixel(view,x,y)
view.GetPixel(x,y)
"""

view = rh.RhinoDoc.ActiveDoc.Views.ActiveView.CaptureToBitmap()
unit = System.Drawing.GraphicsUnit.Pixel
bound = view.GetBounds(unit)[0]
    
widthpx = range(0,int(bound.Width),step)
heightpx = range(0,int(bound.Height),step)
    
colors = []
points = []
for i in widthpx:
    for j in heightpx:
        c = view.GetPixel(i,j)
        colors.append(c)
        pt = rg.Point3d(i,-j+bound.Height,0)
        points.append(pt)
# ---------- end python ----------
bang = ExplodeTree(Data=partition)  # -> Branch0, Branch1, Branch2
pt = ConstructPoint(XCoordinate=bang.Branch0, YCoordinate=bang.Branch1, ZCoordinate=bang.Branch2)
panel = Panel(pt)
tcp_conn = Tcp_conn(IpAddress="127.0.0.1", Port=3141, Run=Toggle(False), Points=pt, Bitmap=python.view)  # -> Status, ReturnedPoint, ReturnedScore
panel_2 = Panel(tcp_conn.Status)
panel_3 = Panel(tcp_conn.ReturnedScore)
panel_4 = Panel(tcp_conn.ReturnedPoint)
